# Grasshopper definition dev.ghx (Grasshopper 1.0.7)

pt = Point([Point(0.07391438232, 0.800656695, 0), Point(0.4409246824, 0.8147989196, 0), Point(0.3487152745, 0.5042773546, 0), Point(0.6358038509, 0.6608711235, 0), Point(0.5928798682, 0.3050057296, 0), Point(0.2601590295, 0.1645595924, 0)])

# ---- group: sum
python = GhPythonScript()
# ---------- python: Python ----------
ll = [[1, 2, 3], [4,5,6]]

ls = []
for i in xrange(len(ll)):
    s = ll[i]
    ls.append(sum(s))

print(ls)
# ---------- end python ----------

# ----
python_2 = GhPythonScript(POINTS=pt)  # -> out, a, b, c, d, e, f; inputs POINTS: list of Point3d
# ---------- python_2: Python ----------
import random
import rhinoscriptsyntax as rs

from gh_marching_cubes import marcing_cubes_2d, metaball_2d, geometry, util

reload(marcing_cubes_2d)
reload(metaball_2d)
reload(geometry)
reload(util)

mc2 = marcing_cubes_2d.Marching_Cubes_2d()
mm2 = metaball_2d.Metaball_2d()
gg = geometry.Geometry()
ut = util.Util()


#######


thr = [0.4, 0.2, 0.1, 0.05, 0.025, 0.0125]
thr0, thr1, thr2, thr3, thr4, thr5 = thr


centers = gg.point3d_to_xy(POINTS)
volumes = [0.3, 0.3, -0.3, 0.3, 0.3, 0.3]

p_grid = ut.gen_array_2d(100)
v_grid = mm2.calc_grids(p_grid, centers, volumes, 100)


lines_pts0 = mc2.gh_marcing_cubes_2d(p_grid, v_grid, thr0)
lines_pts1 = mc2.gh_marcing_cubes_2d(p_grid, v_grid, thr1)
lines_pts2 = mc2.gh_marcing_cubes_2d(p_grid, v_grid, thr2)
lines_pts3 = mc2.gh_marcing_cubes_2d(p_grid, v_grid, thr3)
lines_pts4 = mc2.gh_marcing_cubes_2d(p_grid, v_grid, thr4)
lines_pts5 = mc2.gh_marcing_cubes_2d(p_grid, v_grid, thr5)


a = gg.draw_lines(lines_pts0)
b = gg.draw_lines(lines_pts1)
c = gg.draw_lines(lines_pts2)
d = gg.draw_lines(lines_pts3)
e = gg.draw_lines(lines_pts4)
f = gg.draw_lines(lines_pts5)
# ---------- end python_2 ----------

# ---- group: ut.sum_elements_array
python_3 = GhPythonScript()
# ---------- python_3: Python ----------
import random
import rhinoscriptsyntax as rs

from gh_marching_cubes import marcing_cubes_2d, metaball_2d, util

reload(marcing_cubes_2d)
reload(metaball_2d)
reload(util)

mc2 = marcing_cubes_2d.Marching_Cubes_2d()
mm2 = metaball_2d.Metaball_2d()
ut = util.Util()


a = [[1,2,3], [4,5,6], [10, 20, 30]]
b = ut.sum_elements_array(a)

print(b)
# ---------- end python_3 ----------

# ----
python_4 = GhPythonScript()  # -> a
# ---------- python_4: Python ----------
import random
import rhinoscriptsyntax as rs

from gh_marching_cubes import marcing_cubes_2d, metaball_2d, util

reload(marcing_cubes_2d)
reload(metaball_2d)
reload(util)

mc2 = marcing_cubes_2d.Marching_Cubes_2d()
mm2 = metaball_2d.Metaball_2d()
ut = util.Util()

thr = 0.5
centers = [[0.5, 0.2], [0,0], [0.5, 0.5]]
volumes = [0.3, -0.3, 0.3]

p_grid = ut.gen_array_2d(80)
v_grid = mm2.calc_grids(p_grid, centers, volumes, 100)

print("p_grid : {}".format(ut.print_matrix_info(p_grid)))
print("v_grid : {}".format(ut.print_matrix_info(v_grid)))


#gh_marcing_cubes_2d(p, v, thr)

pt = ut.flatten_array(p_grid)
vv = ut.flatten_array(v_grid)


result = []
for i in xrange(len(pt)):
    nx, ny, nz = pt[i]
    result.append(rs.AddPoint(nx, ny, vv[i]))

a = result

#print(pt[0])
#print(len(p))
# ---------- end python_4 ----------

# ---- group: flatten, unflatten
python_5 = GhPythonScript()
# ---------- python_5: Python ----------
import random
import rhinoscriptsyntax as rs

from gh_marching_cubes import marcing_cubes_2d, metaball_2d, util

reload(marcing_cubes_2d)
reload(metaball_2d)
reload(util)

mc2 = marcing_cubes_2d.Marching_Cubes_2d()
mm2 = metaball_2d.Metaball_2d()
ut = util.Util()


p = ut.gen_array_2d(80)
p_f = ut.flatten_array(p)
p_u = ut.un_flatten_array(p_f)


print("p   : {}".format(ut.print_matrix_info(p)))
print("p_f : {}".format(ut.print_matrix_info(p)))
print("p_u : {}".format(ut.print_matrix_info(p)))
# ---------- end python_5 ----------

# ----
scale = Scale(
    Geometry=[python_2.a, python_2.b, python_2.c, python_2.d, python_2.e, python_2.f],
    Center=Point(0, 0, 0),
    Factor=Slider(1000, range=0..1000))  # -> Geometry, Transform
python_6 = GhPythonScript(x="C:\Users\ysoky\Documents\GH_Marching_Cubes")  # -> out
# ---------- python_6: Python ----------
import sys

sys.path.append(x)
print(sys.path)
# ---------- end python_6 ----------

# ---- group: list_ = []
python_7 = GhPythonScript()
# ---------- python_7: Python ----------
cc = []

print(cc)
print(cc == None)
print(cc == [])
print(cc == [1, 1])
# ---------- end python_7 ----------

# ----
panel = Panel(python_6)
